# Grasshopper definition window_in_wall.ghx (Grasshopper 1.0.7)

reload = Button()
py = PythonScript(reload=reload)
# ---------- py: Python ----------
from compas_rhino.utilities.misc import get_tolerance
from compas_rhino.utilities.misc import unload_modules

from compas_ghpython import unload_modules

unload_modules("compas")
unload_modules("compas_fab")
unload_modules("ur_fabrication_control")
unload_modules("assembly_information_model")
unload_modules("am_information_model")
unload_modules("window_in_wall")
# ---------- end py ----------
py_2 = PythonScript()  # -> HERE, DATA
# ---------- py_2: Python ----------
import os

HERE = os.path.dirname(ghdoc.Path)
DATA = os.path.abspath(os.path.join(HERE, "..", "data"))

#print(HERE)
#print(DATA)
# ---------- end py_2 ----------

width = Number(3.5)
height = Number(3.2)
elsize = Number(0.025)
create_wall = GhPythonScript(init=Button(), width=width, height=height, elsize=elsize)  # -> out, wall
# ---------- create_wall: Python ----------
from window_in_wall import Wall


# create wall
wall = Wall()


# construct COMPAS quad mesh from width and height
wall.create_quad_mesh_from_dimensions(width, height, elsize)
# ---------- end create_wall ----------

wave = GhPythonScript(
    wall=create_wall.wall,
    wave=Toggle(True),
    amp=Slider(0.075, range=0..0.1),
    freq=Slider(2, range=1..3),
    phase=Slider(0, range=0..3))  # -> out, wall; inputs wave: Boolean
# ---------- wave: Python ----------
if wave:
    wall.undulate(amp, freq, phase)
# ---------- end wave ----------

visualize = GhPythonScript(wall=wave.wall)  # -> out, rhmesh
# ---------- visualize: Python ----------
from compas_ghpython.artists import MeshArtist

# Mesh Artist for visualization
artist = MeshArtist(wall.mesh)
#vertices = artist.draw_vertices()
#edges = artist.draw_edges()
#faces = artist.draw_faces()
#labels = {key: key for key in mesh.vertices()}

rhmesh = artist.draw()
# ---------- end visualize ----------
mesh = Mesh(visualize.rhmesh)
preview = CustomPreview(Geometry=mesh, Material=ColourSwatch(SwatchColor=RGB(255, 125, 125)))
